# Grasshopper definition Example.ghx (Grasshopper 1.0.8)
# plug-ins: Vespa

# ComStock DOE Ref 1980-2004
number_slider = Slider(2, range=0..10)
panel = Panel("Office")
c_script = CSharpScript(modelName="gbr_best_Y1_compat_2.onnx")  # -> out, fullPath; inputs modelName: String
# ---------- c_script: C# ----------
// Grasshopper Script Instance
#region Usings
using System;
using System.Linq;
using System.Collections;
using System.Collections.Generic;
using System.Drawing;

using Rhino;
using Rhino.Geometry;

using Grasshopper;
using Grasshopper.Kernel;
using Grasshopper.Kernel.Data;
using Grasshopper.Kernel.Types;
using System.IO;
#endregion

public class Script_Instance : GH_ScriptInstance
{
  // This is the method that runs when the component executes.
  // Make sure you have an output parameter named "dir".
  private void RunScript(string modelName, ref object fullPath)
  {
    // Get the current Grasshopper document from the component that owns this script
    GH_Document doc = this.Component.OnPingDocument();

    // Check if the document and its file path are valid
    if (doc != null && !string.IsNullOrEmpty(doc.FilePath))
    {
      // Extract the directory from the full file path using the fully qualified name
      fullPath = Path.Combine(System.IO.Path.GetDirectoryName(doc.FilePath), modelName);
    }
    else
    {
      // Handle the case where the file has not been saved yet
      this.Component.AddRuntimeMessage(GH_RuntimeMessageLevel.Warning, "The Grasshopper file has not been saved yet.");
      fullPath = "No saved file path found.";
    }
  }

  // You can leave these custom additional fields empty
  #region Custom additional code
  
  #endregion
}
# ---------- end c_script ----------
panel_2 = Panel("Multizone CAV/VAV")
predict = Predict(Model=c_script.fullPath)  # -> OutputMetaData, Output
