# Grasshopper definition Example.ghx (Grasshopper 1.0.8)
# plug-ins: VIP_Energy

panel = Panel("D:\GaTech\VIP-SMUR\SP-25\VIP_Energy\gbr_best_Y1_compat.onnx")
number_slider = Slider(2, range=0..10)
mlvip = BuildingEnergyMLVIP(
    Model=panel,
    Type="Office",
    Shape=number_slider,
    Orientation=number_slider,
    Height=number_slider,
    Stories=number_slider,
    WallArea=number_slider,
    WindowArea=number_slider,
    RoofArea=number_slider,
    EnergyCode="ComStock DOE Ref 1980-2004",
    HVAC="Multizone CAV/VAV")
panel_2 = Panel(mlvip)
